# Grasshopper definition NodeGen.ghx (Grasshopper 1.0.8)
# plug-ins: RhinoCodePluginGH, Speckle 2

# ---- group: RH_IN:Send
# https://macad.speckle.xyz/projects/3a0c9390fa/models/b2062402db
txt = Text()

# ----
synchronous_receiver = SynchronousReceiver(
    Stream=txt,
    AutoReceive=False,
    ReceivedObjectId="81e2e9f816504978c4dade8d5856d32f",
    StreamWrapper="https://macad.speckle.xyz/projects/3a0c9390fa/models/b2062402db",
    selectedKitName="Objects")  # -> Data, Info
sovk = SpeckleObjectValueByKey(Object=synchronous_receiver.Data, Key="elements", selectedKitName="Objects")
sovk_2 = SpeckleObjectValueByKey(Object=sovk, Key="elements", selectedKitName="Objects")
sovk_3 = SpeckleObjectValueByKey(Object=sovk_2, Key="parameters", selectedKitName="Objects")

sovk_4 = SpeckleObjectValueByKey(Object=sovk_3, Key="Node Level", selectedKitName="Objects")
sovk_5 = SpeckleObjectValueByKey(Object=sovk_4, Key="name", selectedKitName="Objects")
sovk_6 = SpeckleObjectValueByKey(Object=sovk_4, Key="value", selectedKitName="Objects")
panel = Panel(sovk_6)
panel_2 = Panel(sovk_5)

sovk_7 = SpeckleObjectValueByKey(Object=sovk_3, Key="57c1a5b6-2d00-478a-9f05-d9a378625293", selectedKitName="Objects")
sovk_8 = SpeckleObjectValueByKey(Object=sovk_7, Key="name", selectedKitName="Objects")
sovk_9 = SpeckleObjectValueByKey(Object=sovk_7, Key="value", selectedKitName="Objects")
panel_3 = Panel(sovk_9)
panel_4 = Panel(sovk_8)

sovk_10 = SpeckleObjectValueByKey(Object=sovk_2, Key="displayValue", selectedKitName="Objects")
face_normals = FaceNormals(Mesh=sovk_10)  # -> Centers, Normals
face_boundaries = FaceBoundaries(Mesh=sovk_10)
python_3_script = Python3Script(x=sovk_6, y=sovk_9)  # -> out, graft(a), graft(b)
# ---------- python_3_script: Python ----------
if bool(x) == True and str(y) == "Sharp":
    a = 20
    b = 15
elif bool(x) == True and str(y) == "Soft":
    a = 60
    b = 30
elif bool(x) == True and str(y) == "Free":
    a = 40
    b = 50
else:
    a = None
    b = None
# ---------- end python_3_script ----------
deconstruct_vector = DeconstructVector(Vector=face_normals.Normals)  # -> XComponent, YComponent, ZComponent
larger_than = LargerThan(FirstNumber=deconstruct_vector.ZComponent, SecondNumber=0)  # -> LargerThan, OrEqualTo
dispatch = Dispatch(List=face_boundaries, DispatchPattern=larger_than.LargerThan)  # -> ListA, ListB
region_union = RegionUnion(Curves=dispatch.ListA)
surface = Surface(region_union)
populate_geometry = PopulateGeometry(Geometry=surface, Count=python_3_script.b, Seed=python_3_script.a)
voronoi = Voronoi(Points=populate_geometry, Boundary=region_union, BruteForceOverride=False)
unit_z = UnitZ(Factor=Slider(3, range=0..10))
panel_5 = Panel("Bot Speckle Token")
extrude = Extrude(Base=voronoi, Direction=unit_z)

# ---- group: RH_IN:Receive
txt_2 = Text()

# ----
# https://macad.speckle.xyz/projects/ba6f903648/models/f23a62921c
panel_6 = Panel("0a7a2c01a136ad89e2cfa5e002c9f1bcbe5656a1d0")
sgetwt = StreamGetWithToken(Stream=txt_2, AuthToken=panel_6)

create_speckle_object = CreateSpeckleObject(Adapted=extrude, selectedKitName="Objects")
ss = SynchronousSender(
    Data=create_speckle_object,
    Stream=sgetwt,
    OutputWrappers="https://macad.speckle.xyz\tba6f903648\t75fe9e2469",
    UseDefaultCache=True,
    selectedKitName="Objects")
